# Grasshopper definition truss_set.gh (Grasshopper 0.9.76)
# plug-ins: Python Interpreter

python = PythonScript(x=Slider(13, range=0..40), y=Slider(1, range=0..10), z=Slider(1.57, range=0..10), segments=Slider(5, range=0..10))  # -> out, a, b, c, d, e
# ---------- python: Python ----------
import rhinoscriptsyntax as rs
import Rhino as rc

#Criar classe Line, Divide, Move, Bars, etc, instanciar no for

i = 0
listLine = []
for i in range(4):
    line = rs.AddLine((0,y,0),(x,y,0))
    listLine.append(line)
    i += 1
print listLine
a = listLine[0]

#divide linha
i = 0
listDivide = []
for i in range(4):
    divide = rs.DivideCurve(listLine[i], segments, create_points=False, return_points=True)
    listDivide.append(divide)
    i += 1

point = listDivide[1]
b = point[1]

#move pontos
i = 0
listMoveSup = []
listMoveInf = []
for i in range(4):
    myVector1 = rc.Geometry.Vector3d(0,0,z)
    move1 = b + myVector1 #b (pq listDivide devolve uma lista, precisa escolher uma linha e depois escolher um ponto dessa linha, seguir..)
    listMoveSup.append(move1)
    myVector2 = rc.Geometry.Vector3d(0,0,-z)
    move2 = b + myVector2
    listMoveInf.append(move2)
c = listMoveSup[0]
d = listMoveInf[0]

#bars
i = 0
bars = []
for i in range(4):
    bar = rs.AddLine(listMoveSup[i], listMoveInf[i])
    bars.append(bar)
    i += 1
e = bars[0]
# ---------- end python ----------
panel = Panel(python.out)
pt = Point(python.d)
pt_2 = Point(python.c)
line = Line(python.a)
geo = Geometry(python.e)
